# Grasshopper definition beetlecat.gh (Grasshopper 1.0.7)
# plug-ins: Pufferfish

# ----
# Station Measurements and Processors
panel = Panel("""RBTSHR
3/4"
1-3/8"
2'1-11/16”
RBTWL16
3/4"
1-1/2”
24"
RBTWL12
3/4"
2-3/32”
20"
RBTWL8
3/4"
3-3/32”
16"
RBTWL4
3/4"
5”
12"
RBTLWL
3/4"
8-27/32”
8"
RBTWL-4
3/4"
1'7"
4"
""")
panel_2 = Panel("""STN0.5SHR
6-32/64”
2'0-18/32”
7-1/2”
STN0.5WL12
5-13/16”
20"
7-1/2”
STN0.5WL8
4-17/32”
16"
7-1/2”
STN0.5WL4
2-17/32”
12"
7-1/2”
STN0.5RBT
0-3/4”
9-1/16”
7-1/2”
STN0.5BOK
0-3/4”
7-9/16”
7-1/2”""")
panel_3 = Panel("""STN2SHR
2'5-4/16”
1'8-15/32”
3’9”
STN2WL12
2'5-3/32”
20"
3’9”
STN2WL8
2'3-31/32”
16"
3’9”
STN2WL4
2'1-13/32”
12"
3’9”
STN2LWL
1'8-15/16”
8"
3’9”
STN2WL-4
11-9/16”
4"
3’9”
STN2B24
24"
10-1/2”
3’9”
STN2B16
16"
5-9/16”
3’9”
STN2B8
8"
3-1/8”
3’9”
STN2RBT
2-5/16”
1-15/16”
3’9”
STN2BOK
2-5/16”
1-1/2”
3’9”""")
panel_4 = Panel("""STN1SHR
1'0-32/32”
1'11-13/32”
1’3”
STN1WL12
1'0-11/32”
20"
1’3”
STN1WL8
10-3/4”
16"
1’3”
STN1WL4
8-1/32”
12"
1’3”
STN1LWL
4-3/16”
8"
1’3”
STN1RBT
0-3/4”
4-7/8”
1’3”
STN1BOK
0-3/4”
4-1/2”
1’3”""")
panel_5 = Panel("""STN1.5SHR
1'10-13/16"
1'9-21/32”
2’6”
STN1.5WL12
1'10-15/32"
20"
2’6”
STN1.5WL8
1'8-31/32”
16"
2’6”
STN1.5WL4
1'5-15/16”
12"
2’6”
STN1.5LWL
1'1-7/32”
8"
2’6”
STN1.5B16
16"
10-1/4”
2’6”
STN1.5B8
8"
5-15/64”
2’6”
STN1.5RBT
1-3/8”
2-20/32”
2’6”
STN1.5BOK
1-3/8”
1-1/2”
2’6”""")
panel_6 = Panel("""STN4SHR
2'10-3/4”
1'8-3/16”
8’9”
STN4WL12
2'10-23/32"
20”
8’9”
STN4WL8
2'9-27/32”
16”
8’9”
STN4WL4
2'7-31/32”
12”
8’9”
STN4LWL
2'3-11/16”
8”
8’9”
STN4B24
24”
6-1/2”
8’9”
STN4B16
16”
5”
8’9”
STN4B8
8”
4-2/32”
8’9”
STN4RBT
2-1/8”
3-9/16”
8’9”
STN4BOK
2-1/8”
3-3/16”
8’9”""")
panel_7 = Panel("""STN3SHR
2'11-1/4”
1'7-9/16”
6’3”
STN3WL8
2'10-11/32”
16"
6’3”
STN3WL4
2'8-7/16”
12"
6’3”
STN3LWL
2'4-7/8”
8"
6’3”
STN3WL-4
1'5-27/32”
4"
6’3”
STN3B24
24"
5-15/32”
6’3”
STN3B16
16"
3-3/4”
6’3”
STN3B8
8"
2-29/32”
6'3"
STN3RBT
2-5/8”
2-1/4”
6’3”
STN3BOK
2-5/8”
1-13/16”
6’3”""")
panel_8 = Panel("""STN5SHR
2'6-17/32"
1'10-11/32"
11'2"
STN5WL12
2'6-9/32”
20"
11’2”
STN5WL8
2'5-7/32”
16"
11’2”
STN5WL4
2'2-7/32”
12"
11’2”
STN5B24
24"
10-9/16”
11’2”
STN5B16
16"
8-14/32”
11’2”
STN5B8
8”
7-6/16”
11’2”
STN5RBT
1”
6-23/32”
11’2”
STN5BOK
1”
6-5/16”
11’2”""")
panel_9 = Panel("""TWOMSHEER
2'3-29/32"
1'11-11/16"
TSOM12WL
2'3-20/32"
20"
TSOM8WL
2'2-3/8"
16"
TSOM4WL
1'10-14/16"
12"
TSOM24B
24"
1'0-14/16"
TSOM16B
16"
9-19/32"
TSOM8B
8"
8-19/32"
TSOMRABBET
0-5/8"
8"
""")
formatstn = FormatStn(L=panel_7)  # -> points, curve
formatstn_2 = FormatStn(L=panel_8)  # -> points, curve
formatstn_3 = FormatStn(L=panel_6)  # -> points, curve
formatstn_4 = FormatStn(L=panel_3)  # -> points, curve
format_sten = FormatSten(L=panel)
formatstn_5 = FormatStn(L=panel_2)  # -> points, curve
formatstn_6 = FormatStn(L=panel_5)  # -> points, curve
formatstn_7 = FormatStn(L=panel_4)  # -> points, curve
format_tsom = FormatTSOM(L=panel_9)  # -> P, C

raw_curves = Curve([formatstn_2.curve, formatstn_3.curve, formatstn.curve, formatstn_4.curve, formatstn_6.curve, formatstn_7.curve, formatstn_5.curve, format_tsom.C])
# Raw Points
# For Rabbet Line
entwine = Entwine(
    Branch00=formatstn_5.points,
    Branch01=formatstn_7.points,
    Branch02=format_tsom.P,
    Branch03=formatstn_6.points,
    Branch04=formatstn_4.points,
    Branch05=formatstn.points,
    Branch06=formatstn_3.points,
    Branch07=formatstn_2.points,
    FlattenInputs=True)
crvgraph = CurvatureGraph(Curve=raw_curves, Density=5, Scale=Slider(111, range=0..300))

# ----
# Rabbet Line
# The Rabbet line is built by taking
# the last point on all relevant sections,
#  along with all the points for the stem,
#  proximity sorting them so they all line up nicely,
#  and then interp+rebuilding a curve.
number_slider = Slider(1, range=0..100)
item = ListItem(List=entwine, Index=0, Wrap=True)
pt = Point(flatten([item, format_sten]))
item_2 = ListItem(List=pt, Index=number_slider, Wrap=True)
ptsortitems = PointSortItems(Start=item_2, Points=pt)  # -> SortedItems, SortedIndices, SortedPoints
pt_2 = Point(ptsortitems.SortedPoints)
intcrv = Interpolate(Vertices=pt_2, Degree=3, Periodic=False, KnotStyle=1)  # -> Curve, Length, Domain
crvgraph_2 = CurvatureGraph(Curve=intcrv.Curve, Density=5, Scale=Slider(111, range=0..1000))
reb = RebuildCurve(Curve=intcrv.Curve, Degree=Slider(4, range=0..10), Count=Slider(16, range=0..100), Tangents=False)
crvgraph_3 = CurvatureGraph(Curve=reb, Density=5, Scale=Slider(111, range=100..201))
crv = Curve(reb)

# ----
# Sheer
# The Sheer line is built much like the Rabbet line,
#  except we don’t really have to worry about stem
#  points except for the very first one.
flip = FlipCurve(Curve=reb)  # -> Curve, Flag
curvepoint = PointOnCurve([raw_curves, flip.Curve], parameter=1)
item_3 = ListItem(List=flatten(curvepoint), Index=0, Wrap=True)
ptsortitems_2 = PointSortItems(Start=item_3, Points=flatten(curvepoint))  # -> SortedItems, SortedIndices, SortedPoints
intcrv_2 = Interpolate(Vertices=ptsortitems_2.SortedPoints, Degree=3, Periodic=False, KnotStyle=1)  # -> Curve, Length, Domain
flip_2 = FlipCurve(Curve=intcrv_2.Curve)  # -> Curve, Flag
crvgraph_4 = CurvatureGraph(Curve=flip_2.Curve, Density=5, Scale=Slider(116, range=0..300))
rebcrv = RebuildCurve(Curve=flip_2.Curve, Count=Slider(12, range=0..100), Degree=Slider(4, range=0..10), EndTangents=False)
crvgraph_5 = CurvatureGraph(Curve=rebcrv, Density=5, Scale=Slider(116, range=0..300))
crv_2 = Curve(rebcrv)

# ----
# Here we jump a bit in complexity…
# Because we have rebuilt both the sheer
# and the rabbet, we now have to have our
# original stations reconfirm to these two
# new master-lines, otherwise we’d end up
# with disjoint sections and rabbet/sheer.
# So, we pick poinst on the rabbet line and sheer
# line to rebuild our sections with.
# Stations
# New Rabbet Points
# New Sections
# New Sheer Points
pt_3 = Point(entwine)
lng = ListLength(List=pt_3)
subtraction = Subtraction(A=lng, B=1)
item_4 = ListItem(List=pt_3, Index=subtraction, Wrap=True)
item_5 = ListItem(List=pt_3, Index=0, Wrap=True)
item_6 = ListItem(List=pt_3, Index=1, Wrap=True)
pl_3pt = Plane3Pt(PointA=item_5, PointB=item_6, PointC=item_4)
pcx = CurvePlane(Curve=reb, Plane=pl_3pt)  # -> Points, ParamsC, ParamsP
pcx_2 = CurvePlane(Curve=rebcrv, Plane=pl_3pt)  # -> Points, ParamsC, ParamsP
replace = ReplaceItems(List=pt_3, Item=pcx.Points, Indices=0, Wrap=False)
replace_2 = ReplaceItems(List=replace, Item=pcx_2.Points, Indices=subtraction, Wrap=False)
intcrv_3 = Interpolate(Vertices=replace_2, Degree=3, Periodic=False, KnotStyle=1)  # -> Curve, Length, Domain
reb_2 = RebuildCurve(Curve=intcrv_3.Curve, Degree=Slider(4, range=0..100), Count=Slider(7, range=0..100), Tangents=False)
crvgraph_6 = CurvatureGraph(Curve=reb_2, Density=Slider(33, range=0..100), Scale=Slider(111, range=0..300))
crv_3 = Curve(flatten(reb_2))

# ----
# Hull
autonetsrf = AutomaticNetworkSurface(Network=flatten([crv_3, crv_2, crv]), ContinuityType=0)

# ----
# Waterlines and
# ButtLines
# Clipping Planes
panel_10 = Panel("""4
8
12
16
20
24""")
panel_11 = Panel("""8
16
24""")
pt_4 = ConstructPoint(XCoordinate=40, YCoordinate=200, ZCoordinate=panel_10)
pt_5 = ConstructPoint(XCoordinate=40, YCoordinate=0, ZCoordinate=panel_10)
pt_6 = ConstructPoint(XCoordinate=0, YCoordinate=0, ZCoordinate=panel_10)
pt_7 = ConstructPoint(XCoordinate=panel_11, YCoordinate=200, ZCoordinate=28)
pt_8 = ConstructPoint(XCoordinate=panel_11, YCoordinate=0, ZCoordinate=28)
pt_9 = ConstructPoint(XCoordinate=panel_11, YCoordinate=0, ZCoordinate=0)
pl_3pt_2 = Plane3Pt(PointA=pt_6, PointB=pt_5, PointC=pt_4)
pl_3pt_3 = Plane3Pt(PointA=pt_9, PointB=pt_8, PointC=pt_7)
brep = Brep(autonetsrf)
sec = BrepPlane(Brep=brep, Plane=pl_3pt_3)  # -> Curves, Points
sec_2 = BrepPlane(Brep=brep, Plane=pl_3pt_2)  # -> Curves, Points
rebcrv_2 = RebuildCurve(Curve=[sec.Curves, sec_2.Curves], Count=Slider(7, range=0..100), Degree=Slider(4, range=0..10), EndTangents=False)

# ----
# 1/2” Offset Hull w/ Projected Rabbet
number_slider_2 = Slider(0.5, range=0..1)
rabbet_curve = Curve(crv)
flip_3 = Flip(Surface=autonetsrf)  # -> Surface, Result
offset = OffsetSurface(Surface=flip_3.Surface, Distance=number_slider_2, Retrim=True)
project = Project(Curve=rabbet_curve, Brep=offset, Direction=Vector(0, 0, 19.04554955))
srfsplit = SurfaceSplit(Surface=offset, Curves=project)
item_7 = ListItem(List=srfsplit, Index=1, Wrap=True)

# ----
# Scaled Hull
scale = Scale(Geometry=[item_7, crv_2], Center=Point(0, 0, 0), Factor=0.33333)  # -> Geometry, Transform
bang = ExplodeTree(Data=scale.Geometry)  # -> Branch0, _0000
scaled_rabbet = Curve(bang.Branch0)
scaled_hull = Brep(bang._0000)

rabbet = Curve(crv_2)
Z = UnitZ(Factor=1)
xz = XZPlane(Origin=Point(0, 0, 0))
xz_2 = XZPlane(Origin=Point(0, 0, 0))
multiplication = Multiplication(A=Slider(5, range=0..10), B=-1)

# ----
# Coordinates for mold planes
panel_12 = Panel("""1'3"
2'6"
3'9"
6'2"
8'8"
11'1"
""")
# Mold Width
panel_13 = Panel("1/2\"")
di = DI_2(ftinfra=panel_12)
di_2 = DI_2(ftinfra=panel_13)
xz_3 = XZPlane(Origin=Point(0, 0, 0))
Y = UnitY(Factor=di)
Y_2 = UnitY(Factor=di_2)

scale_multiplier = Multiplication(A=Y, B=0.3333333)

move = Move(Geometry=xz_3, Motion=scale_multiplier)  # -> Geometry, Transform
move_2 = Move(Geometry=move.Geometry, Motion=Y_2)  # -> Geometry, Transform
weave = Weave(Pattern=[0, 1], Stream0=move.Geometry, Stream1=move_2.Geometry, NullGaps=False)
partition = PartitionList(List=weave, Size=2)

# ----
# Far away lines for verticality check
deplane = DeconstructPlane(Plane=weave)  # -> Origin, XAxis, YAxis, ZAxis
num = Number(2000)
pt_10 = Point(deplane.Origin)
X = UnitX(Factor=num)
Z_2 = UnitZ(Factor=1)
move_3 = Move(Geometry=pt_10, Motion=X)  # -> Geometry, Transform
line = LineSDL(Start=move_3.Geometry, Direction=Z_2, Length=num)

# ----
# Hull Pattern
sec_3 = BrepPlane(Brep=scaled_hull, Plane=partition)  # -> Curves, Points

# ----
# Sheer Points
ccx = CurveCurve(CurveA=sec_3.Curves, CurveB=scaled_rabbet)  # -> Points, ParamsA, ParamsB

ext = ExtendCurve(Curve=sec_3.Curves, Type=1, Start=Slider(0, range=0..10), End=Slider(25, range=0..100))  # -> reparameterize(flatten(Curve))

# ----
# Vertical points
crvprox = CurveProximity(CurveA=ext, CurveB=line)  # -> PointA, PointB, Distance

line_2 = LineSDL(Start=crvprox.PointA, Direction=Z, Length=Slider(20, range=0..100))
crv_cp = CurveClosestPoint(Point=crvprox.PointA, Curve=ext)  # -> Point, Parameter, Distance
shatter = Shatter(Curve=reparameterize(graft(ext)), Parameters=graft(crv_cp.Parameter))
cull = CullPattern(List=flatten(shatter), CullPattern=[True, False])
join = JoinCurves(Curves=[cull, line_2], Preserve=False)

# ----
# Construction Plane
panel_14 = Panel("44\"")
di_3 = DI_2(ftinfra=panel_14)
xy = XYPlane(Origin=Point(0, 0, 0))

scale_multiplier_2 = Multiplication(A=di_3, B=0.3333333)

Z_3 = UnitZ(Factor=scale_multiplier_2)
move_4 = Move(Geometry=xy, Motion=Z_3)  # -> Geometry, Transform

pcx_3 = CurvePlane(Curve=join, Plane=move_4.Geometry)  # -> Points, flatten(ParamsC), ParamsP
shatter_2 = Shatter(Curve=graft(join), Parameters=graft(pcx_3.ParamsC))

# ----
# Station Profiles
cull_2 = CullPattern(List=flatten(shatter_2), CullPattern=[True, False])

curvepoint_2 = PointOnCurve(cull_2, parameter=0)
curvepoint_3 = PointOnCurve(cull_2, parameter=1)
pdecon = Deconstruct(Point=curvepoint_2)  # -> XComponent, YComponent, ZComponent
pdecon_2 = Deconstruct(Point=curvepoint_3)  # -> XComponent, YComponent, ZComponent
pt_11 = ConstructPoint(XCoordinate=0, YCoordinate=pdecon.YComponent, ZCoordinate=pdecon.ZComponent)
pt_12 = ConstructPoint(XCoordinate=0, YCoordinate=pdecon_2.YComponent, ZCoordinate=pdecon_2.ZComponent)
ln = Line(StartPoint=curvepoint_3, EndPoint=pt_12)
ln_2 = Line(StartPoint=curvepoint_2, EndPoint=pt_11)
ln_3 = Line(StartPoint=pt_12, EndPoint=pt_11)
line_3 = Line(ln)
join_2 = JoinCurves(Curves=[cull_2, ln, ln_3, ln_2], Preserve=False)
curvepoint_4 = PointOnCurve(join_2, parameter=0.545)
len = Length(Curve=line_3)
pdecon_3 = Deconstruct(Point=curvepoint_4)  # -> XComponent, YComponent, ZComponent
division = Division(A=len, B=Slider(4, range=0..10))
sort = SortList(Keys=pdecon_3.YComponent, ValuesA=join_2)  # -> Keys, ValuesA
partition_2 = PartitionList(List=sort.ValuesA, Size=2)
multiplication_2 = Multiplication(A=division, B=-1)

# ----
# Staion Molds (Rough)
offset_2 = OffsetCurve(Curve=line_3, Distance=multiplication, Plane=xz, Corners=1)
boundary = BoundarySurfaces(Edges=sort.ValuesA)
loft = Loft(Curves=partition_2, Options={Adjust=False, Closed=False, LoftEnds=0, LoftSimp=0, LoftType=0, Rebuild=10, Refit=0.01})  # -> flatten(Loft)
offset_3 = OffsetCurve(Curve=cull_2, Distance=multiplication_2, Plane=xz_2, Corners=1)

# ==== cluster FormatStn
L = ClusterInput()
cull = CullPattern(List=L, CullPattern=[False, True, True, True])
panel = Panel(cull)
di = DI(ftinfra=panel)
partition = PartitionList(List=di, Size=3)
panel_2 = Panel(partition)
flip = FlipMatrix(Data=panel_2)
bang = ExplodeTree(Data=flip)  # -> Branch0, Branch1, Branch2
pt = ConstructPoint(XCoordinate=bang.Branch0, YCoordinate=bang.Branch2, ZCoordinate=bang.Branch1)
# Cull BOK from generated curve
cull_i = CullIndex(List=pt, Indices=-1, Wrap=True)
sort_pt = SortPoints(Points=cull_i)  # -> Points, Indices
intcrv = Interpolate(Vertices=sort_pt.Points, Degree=3, Periodic=False, KnotStyle=1)  # -> Curve, Length, Domain
points = ClusterOutput(sort_pt.Points)
curve = ClusterOutput(intcrv.Curve)

# ==== cluster FormatSten
L = ClusterInput()
cull = CullPattern(List=L, CullPattern=[False, True, True, True])
panel = Panel(cull)
di = DI(ftinfra=panel)
partition = PartitionList(List=di, Size=3)
panel_2 = Panel(partition)
flip = FlipMatrix(Data=panel_2)
bang = ExplodeTree(Data=flip)  # -> Branch0, Branch1, Branch2
pt = ConstructPoint(XCoordinate=bang.Branch0, YCoordinate=bang.Branch1, ZCoordinate=bang.Branch2)
sort_pt = SortPoints(Points=pt)  # -> Points, Indices
P = ClusterOutput(sort_pt.Points)
intcrv = Interpolate(Vertices=sort_pt.Points, Degree=3, Periodic=False, KnotStyle=1)  # -> Curve, Length, Domain

# ==== cluster FormatTSOM
L = ClusterInput()
di = DI(ftinfra="11'9-3/8\"")
di_2 = DI(ftinfra="11'9-3/8\"")
di_3 = DI(ftinfra="12'4\"")
di_4 = DI(ftinfra="2'1-9/16\"")
X = UnitX(Factor=1)
cull = CullPattern(List=L, CullPattern=[False, True, True])
di_5 = DI(ftinfra=cull)
pt = ConstructPoint(XCoordinate=0, YCoordinate=di, ZCoordinate=0)
pt_2 = ConstructPoint(XCoordinate=X, YCoordinate=di_2, ZCoordinate=0)
pt_3 = ConstructPoint(XCoordinate=0, YCoordinate=di_3, ZCoordinate=di_4)
partition = PartitionList(List=di_5, Size=2)
pl_3pt = Plane3Pt(PointA=pt, PointB=pt_2, PointC=pt_3)
flip = FlipMatrix(Data=partition)
bang = ExplodeTree(Data=flip)  # -> Branch0, Branch1
pt_4 = ConstructPoint(XCoordinate=bang.Branch0, YCoordinate=0, ZCoordinate=bang.Branch1)
sort_pt = SortPoints(Points=pt_4)  # -> Points, Indices
Y = UnitY(Factor=1)
line = LineSDL(Start=sort_pt.Points, Direction=Y, Length=Slider(162, range=0..1000))
plx = LinePlane(Line=line, Plane=pl_3pt)  # -> Point, ParamL, ParamP
# Transom Curve
P = ClusterOutput(plx.Point)
intcrv = Interpolate(Vertices=plx.Point, Degree=3, Periodic=False, KnotStyle=1)  # -> Curve, Length, Domain
C = ClusterOutput(intcrv.Curve)

# ==== cluster DI_2
ftinfra = ClusterInput()
ftinfra_decimalinches = GhPythonScript(x=ftinfra)  # -> decimal, ft, inches, fraction, decFraction
# ---------- ftinfra_decimalinches: Python ----------
"""Converts units in ft'in-fr" or ft'in" or ft' or in" into decimal inches.
    Inputs:
        x: The value (text) to convert.
    Output:
        decimal: The full decimal value.
        ft: Only the ft.
        inches: Only the inches component.
        fraction: only the fraction component.
        decFraction: only the fraction as a decimal."""

__author__ = "niko"

import rhinoscriptsyntax as rs
import re
from fractions import Fraction

"""((?<ft>^[0-9]+)')?((?<in>[0-9]+)?-?(?<fr>[0-9]+\/[0-9]+)?")?
"""
match = re.search(r'((?<ft>^[0-9]+)[\'’])?((?<in>[0-9]+)?-?(?<fr>[0-9]+\/[0-9]+)?["”])?', x)

ft = match.group('ft')
inches = match.group('in')
fraction = match.group('fr')
decFraction = float(Fraction(fraction)) if fraction else None

decimal = ((int(ft) if ft else 0) * 12) + (int(inches) if inches else 0) + (decFraction if decFraction else 0)
# ---------- end ftinfra_decimalinches ----------
decimal = ClusterOutput(ftinfra_decimalinches.decimal)

# ==== cluster DI
ftinfra = ClusterInput()
ftinfra_decimalinches = GhPythonScript(x=ftinfra)  # -> decimal, ft, inches, fraction, decFraction
# ---------- ftinfra_decimalinches: Python ----------
__author__ = "niko"

import rhinoscriptsyntax as rs
import re
from fractions import Fraction

"""((?<ft>^[0-9]+)')?((?<in>[0-9]+)?-?(?<fr>[0-9]+\/[0-9]+)?")?
"""
match = re.search(r'((?<ft>^[0-9]+)[\'’])?((?<in>[0-9]+)?-?(?<fr>[0-9]+\/[0-9]+)?["”])?', x)

ft = match.group('ft')
inches = match.group('in')
fraction = match.group('fr')
decFraction = float(Fraction(fraction)) if fraction else None

decimal = ((int(ft) if ft else 0) * 12) + (int(inches) if inches else 0) + (decFraction if decFraction else 0)
# ---------- end ftinfra_decimalinches ----------
decimal = ClusterOutput(ftinfra_decimalinches.decimal)
