# Grasshopper definition beetlecat_bu.gh (Grasshopper 1.0.7)

L = List()
di = DI(ftinfra="11'9-3/8\"")
di_2 = DI(ftinfra="11'9-3/8\"")
di_3 = DI(ftinfra="12'4\"")
di_4 = DI(ftinfra="2'1-9/16\"")
X = UnitX(Factor=1)
cull = CullPattern(List=L, CullPattern=[False, True, True])
di_5 = DI(ftinfra=cull)
pt = ConstructPoint(XCoordinate=0, YCoordinate=di, ZCoordinate=0)
pt_2 = ConstructPoint(XCoordinate=X, YCoordinate=di_2, ZCoordinate=0)
pt_3 = ConstructPoint(XCoordinate=0, YCoordinate=di_3, ZCoordinate=di_4)
partition = PartitionList(List=di_5, Size=2)
pl_3pt = Plane3Pt(PointA=pt, PointB=pt_2, PointC=pt_3)
flip = FlipMatrix(Data=partition)
bang = ExplodeTree(Data=flip)  # -> Branch0, Branch1
pt_4 = ConstructPoint(XCoordinate=bang.Branch0, YCoordinate=0, ZCoordinate=bang.Branch1)
sort_pt = SortPoints(Points=pt_4)  # -> Points, Indices
Y = UnitY(Factor=1)
line = LineSDL(Start=sort_pt.Points, Direction=Y, Length=Slider(162, range=0..1000))
plx = LinePlane(Line=line, Plane=pl_3pt)  # -> Point, ParamL, ParamP
# Transom Curve
P = Point(plx.Point)
intcrv = Interpolate(Vertices=plx.Point, Degree=3, Periodic=False, KnotStyle=1)  # -> Curve, Length, Domain
C = Curve(intcrv.Curve)

# ==== cluster DI
ftinfra = ClusterInput()
ftinfra_decimalinches = GhPythonScript(x=ftinfra)  # -> decimal, ft, inches, fraction, decFraction
# ---------- ftinfra_decimalinches: Python ----------
__author__ = "niko"

import rhinoscriptsyntax as rs
import re
from fractions import Fraction

"""((?<ft>^[0-9]+)')?((?<in>[0-9]+)?-?(?<fr>[0-9]+\/[0-9]+)?")?
"""
match = re.search(r'((?<ft>^[0-9]+)[\'’])?((?<in>[0-9]+)?-?(?<fr>[0-9]+\/[0-9]+)?["”])?', x)

ft = match.group('ft')
inches = match.group('in')
fraction = match.group('fr')
decFraction = float(Fraction(fraction)) if fraction else None

decimal = ((int(ft) if ft else 0) * 12) + (int(inches) if inches else 0) + (decFraction if decFraction else 0)
# ---------- end ftinfra_decimalinches ----------
decimal = ClusterOutput(ftinfra_decimalinches.decimal)
